# Grasshopper definition hello.gh (Grasshopper 1.0.8)
# plug-ins: Conduit+

# ---- group: 1 Your data · six rooms, metres
six_room_faces_metres = Rectangle([{Plane=PlaneXY(0, 0, 0), Size=Domain2(u=0..4, v=0..3)}, {Plane=PlaneXY(0, 5, 0), Size=Domain2(u=0..6, v=0..3)}, {Plane=PlaneXY(10, 0, 0), Size=Domain2(u=0..5, v=0..3)}, {Plane=PlaneXY(10, 5, 0), Size=Domain2(u=0..8, v=0..3)}, {Plane=PlaneXY(20, 0, 0), Size=Domain2(u=0..3, v=0..3)}, {Plane=PlaneXY(20, 5, 0), Size=Domain2(u=0..4, v=0..3)}])
room_names = Panel("""Studio 01
Studio 02
Meeting 01
Meeting 02
Store 01
Store 02""")
programme = Panel("""Studio
Studio
Meeting
Meeting
Store
Store""")
area_m² = Panel("""12
18
15
24
9
12""")
minimum_area_m² = Panel("15")
boundary = BoundarySurfaces(Edges=six_room_faces_metres)  # -> flatten(Surfaces)

# ---- group: 2 Cards · Metric, Bar, Table + programme preview
smaller = SmallerThan(FirstNumber=area_m², SecondNumber=minimum_area_m²)  # -> SmallerThan, OrEqualTo
ma = MassAddition(Input=area_m²)  # -> Result, PartialResult
cull = CullPattern(List=area_m², CullPattern=smaller.SmallerThan)
lng = ListLength(List=cull)
entwine = Entwine(Branch00=room_names, Branch01=programme, Branch02=area_m², FlattenInputs=True)
colcat = ColourCategories(Categories=programme, Keys=room_names, Palette="Programme", Title="Programme", Slot="tr", ShowCounts=True)  # -> Colours, Legend, Categories, CategoryColours, GroupKeys, Members
merge = Merge(Data1=ma.Result, Data2=lng)
bar = Bar(
    Values=area_m²,
    Labels=room_names,
    Title="Area ≥ minimum (m²)",
    Threshold=minimum_area_m²,
    Slot="tl",
    GoodWhen="Above",
    Sort="Worst first",
    VisibleRows=12,
    ConduitPlus_DefaultsVersion=1)
table = Table(Headers=["Room", "Type", "Area m²"], Title="Room schedule", Slot="tr", VisibleRows=6, Width=360, Columns=entwine)
metric = Metric(Value=merge, Title=["Total area", "Rooms below minimum"], Unit=["m²", ""], Slot="tl", Decimals=0)
programme_preview = CustomPreview(Geometry=boundary, Material=colcat.Colours)

# ---- group: 3 Show it · Overlay + stacked Canvas Card
link = Link(Geometry=boundary, Keys=flatten(room_names))
scope = Scope(Name="Room review")
merge_2 = Merge(Data1=flatten(metric), Data2=flatten(bar), Data3=flatten(table))
merge_3 = Merge(Data1=flatten(metric), Data2=flatten(bar), Data3=flatten(table), Data4=flatten(colcat.Legend))
overlay = Overlay(Cards=merge_3, Links=link, Scope=scope, ConduitPlus_Theme="Auto")  # -> Selection, Events
canvas_card = CanvasCard(Cards=merge_2, Scope=scope, ConduitPlus_CanvasTheme="Paper")
