# Grasshopper definition massing.gh (Grasshopper 1.0.8)
# plug-ins: Conduit+

# ---- group: 1 Explore schematic geometry (metres)
extra_floors_per_block = Slider(0, range=-1..5)
massing = DemoMassing(ExtraFloors=extra_floors_per_block)  # -> Blocks, Keys, HeightRatios, Rows, GFA, AllowedGFA, FAR, Uses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

# ---- group: 2 Cards · explicit room/block keys
metric = Metric(Value=massing.GFA, Title="Total GFA", Unit="m²", Slot="tl", Decimals=0)
metric_2 = Metric(Value=massing.AllowedGFA, Title="Allowed GFA", Unit="m²", Slot="tl", Decimals=0)
metric_3 = Metric(Value=massing.FAR, Title="FAR (allowed 2.0)", Unit="ratio", Slot="tl", Decimals=2)
metric_4 = Metric(
    Value=massing.HeightFailures,
    Title="Blocks above 30 m",
    Slot="tl",
    Decimals=0,
    Key="above-height-limit",
    Members=massing.HeightFailureMembers)
bar = Bar(
    Values=massing.HeightRatios,
    Labels=massing.Keys,
    Keys=massing.Keys,
    Title="Height / 30 m limit",
    Threshold=1,
    Slot="tr",
    VisibleRows=12,
    ConduitPlus_DefaultsVersion=1)
table = Table(
    Headers=["Block", "Use", "Floors", "Height m", "Limit m", "GFA m²"],
    Rows=massing.Rows,
    Keys=massing.Keys,
    Title="Block schedule",
    Slot="br",
    VisibleRows=8,
    Width=600)
legend = Legend(
    Colors=massing.UseColors,
    Labels=massing.Uses,
    Keys=massing.UseKeys,
    Title="Building uses",
    Slot="tl",
    Members=massing.UseMembers)
bar_2 = Bar(
    Values=massing.GFAByUse,
    Labels=massing.Uses,
    Keys=massing.UseKeys,
    Title="GFA by use (m²)",
    Threshold=16000,
    Slot="tl",
    Colors=massing.UseColors,
    Members=massing.UseMembers,
    VisibleRows=12,
    ConduitPlus_DefaultsVersion=1)
text = Text(
    Title="Schematic zoning study",
    Text="""100 × 80 m site · FAR limit 2.0 · height limit 30 m.
GFA counts whole floorplates. Limits are fictitious.
Click a face or row; change Extra floors.""",
    Width=280,
    Slot="tl")

# ---- group: 3 Click geometry ↔ row
link = Link(Geometry=massing.Blocks, Keys=flatten(massing.Keys))
overlay = Overlay(
    Cards=flatten([metric, metric_2, metric_3, metric_4, bar, table, legend, bar_2, text]),
    Links=flatten(link),
    ConduitPlus_Theme="Auto")  # -> Selection, Events
