# Grasshopper definition room-areas.gh (Grasshopper 1.0.8)
# plug-ins: Conduit+

# ---- group: Schematic GIA includes Hall; walls omitted. Net excludes Hall. Fictitious minima, not regulations. / 1 Explore schematic geometry (metres)
plan_scale_minima_fixed = Slider(1, range=0.5..2)
rooms = DemoRooms(PlanScale=plan_scale_minima_fixed)  # -> Rooms, Keys, Names, AreaDelta, Rows, GIA, NetToGross, Circulation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

# ---- group: 2 Cards · explicit room/block keys
metric = Metric(Value=rooms.GIA, Title="Schematic GIA", Unit="m²", Slot="tl", Decimals=0)
metric_2 = Metric(Value=rooms.NetToGross, Title="Net / gross", Unit="%", Slot="tl", Decimals=1)
metric_3 = Metric(Value=rooms.Circulation, Title="Circulation", Unit="%", Slot="tl", Decimals=1)
metric_4 = Metric(
    Value=rooms.FailingRooms,
    Title="Rooms below minimum",
    Slot="tl",
    Decimals=0,
    Key="below-minimum",
    Members=rooms.FailingMembers)
bar = Bar(
    Values=rooms.AreaDelta,
    Labels=rooms.Names,
    Keys=rooms.Keys,
    Title="Area − minimum (m²)",
    Threshold=0,
    Slot="tr",
    Colors=rooms.StatusColors,
    VisibleRows=12,
    ConduitPlus_DefaultsVersion=1)
table = Table(
    Headers=["Room", "Type", "m²", "Min m²", "Δ m²", "Status"],
    Rows=rooms.Rows,
    Keys=rooms.Keys,
    Title="Room area check",
    Slot="br",
    VisibleRows=8,
    Width=600)
legend = Legend(
    Colors=rooms.TypeColors,
    Labels=rooms.Types,
    Keys=rooms.TypeKeys,
    Title="Room types",
    Slot="tl",
    Members=rooms.TypeMembers)

# ---- group: 4 Shared room selection · Canvas ↔ viewport
scope = Scope(Name="Room review")
canvas_card = CanvasCard(Cards=table, Scope=scope, ConduitPlus_CanvasTheme="Auto")

# ---- group: 3 Click geometry ↔ row
link = Link(Geometry=rooms.Rooms, Keys=flatten(rooms.Keys))
overlay = Overlay(
    Cards=flatten([metric, metric_2, metric_3, metric_4, bar, table, legend]),
    Links=flatten(link),
    Scope=scope,
    ConduitPlus_Theme="Auto")  # -> Selection, Events
