# Grasshopper definition structural-dashboard.gh (Grasshopper 1.0.8)
# plug-ins: Conduit+

# ---- group: 1 Explore span and load · illustrative data only
span_m = Slider(24, range=12..36)
load_kn_m = Slider(12, range=0..24)
truss = DemoTruss(Span=span_m, Bays=4, Depth=3, Load=load_kn_m)  # -> Members, Keys, Labels, Utilisation, Deflection, Mass, Rows, MaxUtilisation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

# ----
scale_minimum = Slider(0, range=0..0)
scale_maximum = Slider(1.2, range=1.2..1.2)

# ---- group: 2 Result cards · double-click inputs to inspect constants
bar = Bar(
    Values=truss.Utilisation,
    Labels=truss.Labels,
    Keys=truss.Keys,
    Title="Bar",
    Slot="tr",
    VisibleRows=12,
    ConduitPlus_DefaultsVersion=1)
table = Table(
    Headers=["Member", "Type", "Util.", "Length (m)"],
    Rows=truss.Rows,
    Keys=truss.Keys,
    Title="Member results",
    Slot="tr",
    VisibleRows=8,
    Width=380)
metric = Metric(Value=truss.MaxUtilisation, Title="Max utilisation", Unit="ratio", Slot="tl")
metric_2 = Metric(Value=truss.MaxDeflection, Title="Max deflection", Unit="mm", Slot="tl")
metric_3 = Metric(Value=truss.Mass, Title="Total mass", Unit="t", Slot="tl")
metric_4 = Metric(Value=truss.MembersPassing, Title="Members passing", Slot="tl")
line = Line(Values=truss.Deflection, Labels=truss.Stations, Title="Deflection along span (mm)", Slot="tl")
legend = Legend(
    Colors=[RGB(31, 138, 91), RGB(229, 182, 61), RGB(194, 51, 77)],
    Min=scale_minimum,
    Max=scale_maximum,
    Unit="ratio",
    Title="Utilisation scale",
    Slot="tr")
text = Text(
    Title="Illustrative example",
    Text="""Illustrative results. Click a bar or a member.
Change Span or Load in Grasshopper.
Not structural analysis or design verification.""",
    Width=280,
    Slot="tl")
title = Title(
    Title="Truss utilisation review",
    Subtitle="4 bays · 24 m span",
    Description="Illustrative results; not structural analysis or design verification.",
    Position="tc")

# ---- group: 3 Keyed geometry → viewport
link = Link(Geometry=truss.Members, Keys=flatten(truss.Keys))
overlay = Overlay(
    Cards=flatten([metric, metric_2, metric_3, metric_4, bar, table, line, legend, text, title]),
    Links=flatten(link),
    ConduitPlus_Theme="Auto")  # -> Selection, Events
